# Grasshopper definition Test1.ghx (Grasshopper 1.0.8)
# Copyright: Copyright 2024 Corgan Associates, Inc

# Corgan Practice Technology Grasshopper Template 0.1
number_slider = Slider(10, range=0..50)

# ----
# Mapped 3D text object
planar = BoundarySurfaces()
pt = ConstructPoint(XCoordinate=0, YCoordinate=0, ZCoordinate=0)
extr = Extrude(Base=planar, Direction=pt)
rotate = Rotate(Geometry=extr, Center=Point(0, 0, 0), From=Vector(1, 0, 0), To=Vector(0, 1, 0))  # -> Geometry, Transform
bbox = BoundingBox(Content=rotate.Geometry, Plane=PlaneXY(0, 0, 0), UnionBox=True)  # -> Box, Box_2
debox = DeconstructBox(Box=bbox.Box)  # -> Plane, X, Y, Z
multiplication = Multiplication(B=0.5)
mirror = Mirror(Geometry=rotate.Geometry, Plane=PlaneYZ(0, 0, 0))  # -> Geometry, Transform
dedomain = DeconstructDomain(Domain=debox.Y)  # -> Start, End
dedomain_2 = DeconstructDomain(Domain=debox.X)  # -> Start, End
multiplication_2 = Multiplication(A=dedomain_2.Start, B=-1)
addition = Addition(A=multiplication_2, B=dedomain_2.End)
addition_2 = Addition(A=multiplication, B=dedomain.Start)
addition_3 = Addition(A=multiplication, B=dedomain.End)
dom = ConstructDomain(DomainStart=0, DomainEnd=addition)
dom_2 = ConstructDomain(DomainStart=addition_2, DomainEnd=addition_3)
dom_3 = ConstructDomain(DomainStart=0, DomainEnd=1)
srfmorph = SurfaceMorph(Geometry=mirror.Geometry, Reference=bbox.Box, UDomain=dom, VDomain=dom_2, WDomain=dom_3)

populate_3d = Populate3D(Region={Plane=PlaneXY(0, 0, 0), X=Domain(0, 10), Y=Domain(0, 10), Z=Domain(0, 2)}, Count=number_slider, Seed=1)
text = Text()
panel = Panel(text)
panel_2 = Panel(populate_3d)
sphere = Sphere(Base=panel_2, Radius=1)
sphere_2 = Sphere(Base=panel_2, Radius=1)
